# Grasshopper definition curved_slicing_master.gh (Grasshopper 1.0.7)
# plug-ins: Pufferfish

# ---- group: FOLDER
data_folder_name = Panel("data_advanced_example\")

data_folder_name_2 = Panel("data_basic_example\")

# ---- group: Selection
list = ValueList({"Basic example": 0, "Advanced example": 1}, selected="Basic example")

# ----
connection = Mesh(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)
vase = Mesh(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)
merge = Merge(Data1=flatten(data_folder_name_2), Data2=flatten(data_folder_name))
merge_2 = Merge(Data1=flatten(vase), Data2=flatten(connection))
item = ListItem(List=merge, Index=list, Wrap=True)
item_2 = ListItem(List=merge_2, Index=list, Wrap=True)

# ----
# Input
# Inputs
py = PythonScript()  # -> path
# ---------- py: Python ----------
import sys
import os

ghComp = ghenv.Component
ghDoc = ghComp.OnPingDocument()

# the full path of the gh file
path = ghDoc.FilePath
# the current directory 
path = os.path.abspath(os.path.join(path, ".."))

print path
# ---------- end py ----------

# ---- group: Folder name
data = Data(item)

# ---- group: Input mesh
mesh = Mesh(item_2)

# ----
mesh_2 = Mesh(mesh)

# ---- group: Path cross-section
# Visualization
xz = XZPlane(Origin=Point(0, 0, 0))
rectangle = Rectangle(Plane=xz, XSize=Slider(2.5, range=0..10), YSize=Slider(1, range=0..10), Radius=Slider(0.43, range=0..1))  # -> Rectangle, Length

# ----
medges = MeshEdges(Mesh=mesh_2)  # -> NakedEdges, InteriorEdges, NonManifoldEdges

# ----
# Debugging
# Single distance list
button = Button()
offset = Slider(47.4, range=0..200)
csloadjsondata = CsLoadJsonData(recompute=button, json_name="distances_LOW.json", path=py, folder_name=data)  # -> out, data; inputs recompute: Boolean
# ---------- csloadjsondata: Python ----------
"""Loads a json file from the output folder. """

import compas_slicer_ghpython.visualization as gh_compas_slicer
gh_compas_slicer = reload(gh_compas_slicer)

if json_name and path and folder_name:
    data = gh_compas_slicer.load_json_file(path, folder_name, json_name)
else:
    gh_compas_slicer.missing_input()
# ---------- end csloadjsondata ----------
bnd = Bounds(Numbers=csloadjsondata.data)
bounds = Panel(bnd)
olffset = GhPythonScript(values=csloadjsondata.data, offset=offset)  # -> a; inputs values: list
# ---------- olffset: Python ----------
a = [v-offset for v in values]
# ---------- end olffset ----------

# ----
# Load Printpoints
panel = Panel("out_printpoints.json")
csloadprintpoints = CsLoadPrintpoints(recompute=Button(), json_name=panel, path=py, folder_name=data)  # -> out, paths; inputs recompute: Boolean
# ---------- csloadprintpoints: Python ----------
"""
Loads a dictionaly of Printpoints from a json file in the 'output' folder.

"""

import compas_slicer_ghpython.visualization as gh_compas_slicer
gh_compas_slicer = reload(gh_compas_slicer)


if path and folder_name and json_name:
    paths = gh_compas_slicer.load_printpoints(path, folder_name, json_name)
    
else:
    gh_compas_slicer.missing_input()
# ---------- end csloadprintpoints ----------

# ----
# Output
# Load Slicer
panel_2 = Panel("curved_slicer.json")
csloadslicer = CsLoadSlicer(recompute=Button(), json_name=panel_2, path=py, folder_name=data)  # -> out, mesh, travel_to_contours, contours, contours_are_closed, travel_to_infills, infills; inputs recompute: Boolean
# ---------- csloadslicer: Python ----------
"""
Loads a Slicer class from its json file in the 'output' folder.

"""

import compas_slicer_ghpython.visualization as gh_compas_slicer
gh_compas_slicer = reload(gh_compas_slicer)


if path and folder_name and json_name:
    mesh, travel_to_contours, contours, contours_are_closed, travel_to_infills, infills = gh_compas_slicer.load_slicer(path, folder_name, json_name)
    
else:
    gh_compas_slicer.missing_input()
# ---------- end csloadslicer ----------

join = JoinCurves(Curves=flatten(medges.NakedEdges), Preserve=False)

# ----
# Simple interpolation
panel_3 = Panel("distances_HIGH.json")
weight = Slider(0.5, range=0..1)
csinterpolation = CsInterpolation(recompute=Button(), json_name1="distances_LOW.json", json_name2=panel_3, weight=weight, path=py, folder_name=data)  # -> out, interpolation; inputs recompute: Boolean
# ---------- csinterpolation: Python ----------
"""
Interpolation of the two distance fields that are loaded from the 'output' folder. 

"""

import compas_slicer_ghpython.visualization as gh_compas_slicer
gh_compas_slicer = reload(gh_compas_slicer)

if json_name1 and json_name2 and path and folder_name:
    interpolation = gh_compas_slicer.distance_fields_interpolation(path, folder_name, json_name1, json_name2, weight)
else:
    gh_compas_slicer.missing_input()
# ---------- end csinterpolation ----------

item_3 = ListItem(List=flatten(join), Index=0, Wrap=True)  # -> Item, Item1
list_2 = ValueList({"travel to contour": 0, "contour": 1, "travel to infill": 2, "infill": 3}, selected="contour")
# Export boundary vertices to json
number_slider = Slider(8, range=0..20)

crv = Curve(item_3.Item1)
mesh_3 = Mesh(mesh_2)
crv_2 = Curve(item_3.Item)

toggle = BooleanToggle(False)
python = GhPythonScript(paths=csloadprintpoints.paths, path_index=Slider(58, range=0..100), path_type=list_2, display_all=Toggle(True))  # -> out, geometry, points, frames, layer_heights, up_vectors, mesh_normals, closest_support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; inputs paths: list, path_index: Int32, path_type: Int32, display_all: Boolean
# ---------- python: Python ----------
"""
Visualizes PrintPoints information of compas_slicer paths.

"""

import compas_slicer_ghpython.visualization as gh_compas_slicer
gh_compas_slicer = reload(gh_compas_slicer)

if path_type == 0:
    path_type = 'travel_to_contour'
elif path_type == 1:
    path_type = 'contour'
if path_type == 2:
    path_type = 'travel_to_infill'
elif path_type == 3:
    path_type = 'infill'

if path_index >= len(paths):
    path_index = len(paths)-1
    
if len(paths) > 0:
    points, frames, layer_heights, up_vectors, mesh_normals, closest_support, velocities, wait_times, \
    blend_radiuses, extruder_toggles = gh_compas_slicer.get_path_viz(paths, path_index, path_type, display_all)
# ---------- end python ----------

# ---- group: Visualize boundaries
pipe = Pipe(Curve=join, Radius=Slider(0.3, range=0..1), Caps=0)
preview = CustomPreview(Geometry=pipe, Material=ColourSwatch(SwatchColor=RGB(0, 0, 0)))

# ----
panel_4 = Panel(csloadslicer.out)

travel_to_contours = Curve(csloadslicer.travel_to_contours)
travel_to_infills = Curve(csloadslicer.travel_to_infills)
contours = Curve(csloadslicer.contours)
infills = Curve(csloadslicer.infills)
mesh_4 = Mesh(csloadslicer.mesh)

cstargetinput = CsTargetInput(
    compute=toggle,
    mesh=mesh_3,
    targets=flatten(crv_2),
    resolution_mult=number_slider,
    path=py,
    folder_name=data,
    json_name="boundaryHIGH.json")  # -> out, all_pts, target_vs, target_vi; inputs compute: Boolean, mesh: Mesh, targets: list of Curve, resolution_mult: Int32
# ---------- cstargetinput: Python ----------
"""
Creates a json file with the specified targets' information, needed for curved slicing with compas_slicer.

"""

import compas_slicer_ghpython.visualization as gh_compas_slicer
gh_compas_slicer = reload(gh_compas_slicer)


if compute:
    if mesh and targets and resolution_mult and path and folder_name and json_name:
        all_pts, target_vs, target_vi = \
        gh_compas_slicer.create_targets(mesh, targets, resolution_mult, path, folder_name, json_name)
    else:
        gh_compas_slicer.missing_input()
else:
    print('Compute is set to False')
# ---------- end cstargetinput ----------
cstargetinput_2 = CsTargetInput(
    compute=toggle,
    mesh=mesh_3,
    targets=flatten(crv),
    resolution_mult=number_slider,
    path=py,
    folder_name=data,
    json_name=["boundaryHIGH.json", "boundaryLOW.json"])  # -> out, all_pts, target_vs, target_vi; inputs compute: Boolean, mesh: Mesh, targets: list of Curve, resolution_mult: Int32; same code as cstargetinput

# ----
# Visualize geodesic distances
distances = Number(olffset)
distances_2 = Number(csinterpolation.interpolation)

panel_5 = Panel(python.out)

points = Point(python.points)
frames = Plane(python.frames)
up_vectors = Vector(python.up_vectors)
mesh_normals = Vector(python.mesh_normals)
layer_heights = Number(python.layer_heights)
cpts = Point(python.closest_support)

velocities = Number(python.velocities)
wait_times = Number(python.wait_times)
blend_radiuses = Number(python.blend_radiuses)
extruder_toggles = Number(python.extruder_toggles)

pline = PolyLine(Vertices=points, Closed=False)
vdis = VectorDisplay(Anchor=points, Vector=expr("x*5", up_vectors))
abs = Absolute(Value=distances_2)
pt = Point(cstargetinput.target_vs)
pt_2 = Point(cstargetinput_2.target_vs)

# ---- group: Visualize distance values on mesh
distances_3 = Number(abs)
mesh_5 = Mesh(mesh)

bnd_2 = Bounds(Numbers=distances_3)
dedomain = DeconstructDomain(Domain=bnd_2)  # -> Start, End
gradient = Gradient(
    LowerLimit=dedomain.Start,
    UpperLimit=dedomain.End,
    Parameter=distances_3,
    stops=[0: RGB(0, 128, 0), 0.0566: RGB(255, 255, 0), 0.915: RGB(255, 0, 0)])
demesh = DeconstructMesh(Mesh=mesh_5)  # -> Vertices, Faces, Colours, Normals
conmesh = ConstructMesh(Vertices=demesh.Vertices, Faces=demesh.Faces, Colours=gradient)

# ---- group: Find critical points
critical_pts = GhPythonScript(recompute=Button(), distances=csloadjsondata.data, mesh=mesh)  # -> out, saddles, minima, maxima; inputs distances: list, mesh: Mesh
# ---------- critical_pts: Python ----------
__author__ = "Ioanna"
__version__ = "2020.11.02"

import rhinoscriptsyntax as rs
from compas.datastructures import Mesh

def count_sign_changes(values):
    count = 0
    prev_v = 0
    for i, v in enumerate(values):
        if i == 0:
            prev_v = v
        else:
            if prev_v * v < 0:
                count += 1
            prev_v = v
    return count
    
vs = [[v.X, v.Y, v.Z] for v in rs.MeshVertices(mesh)]
fs = [[f[0], f[1], f[2]] for f in rs.MeshFaceVertices(mesh)]
compas_mesh= Mesh.from_vertices_and_faces(vs, fs)


saddles, minima, maxima = [], [], []
for i, current_v in enumerate(distances):
    neighbors = compas_mesh.vertex_neighbors(i, ordered=True)
    values = []
    if len(neighbors) > 0:
        neighbors.append(neighbors[0])
        for n in neighbors:
            v = distances[n]
            if abs(v - current_v) > 0.0:
                values.append(current_v - v)
        sgc = count_sign_changes(values)

        if sgc == 0:  # extreme point
            if current_v > distances[neighbors[0]]:
                maxima.append(i)
            else:
                minima.append(i)
        if sgc == 2:  # regular point
            pass
        if sgc > 2 and sgc % 2 == 0:
            saddles.append(i)
# ---------- end critical_pts ----------
item_4 = ListItem(List=demesh.Vertices, Index=critical_pts.minima, Wrap=True)
cloud = CloudDisplay(Points=item_4, Colours=ColourSwatch(SwatchColor=RGB(18, 204, 255)), Size=Slider(1.234, range=0..10), SpriteType=1)

# ----
# Load Vectors
panel_6 = Panel("gradient.json")
csloadjsonvectors = CsLoadJsonVectors(recompute=Button(), json_name=panel_6, path=py, folder_name=data)  # -> out, vectors; inputs recompute: Boolean
# ---------- csloadjsonvectors: Python ----------
"""
Loads a json file from the 'output' folder, 
that stores a vector field in the format: 
data['0']=[x0,y0,z0], ...,  data['N']=[xN,yN,zN]


"""

import compas_slicer_ghpython.visualization as gh_compas_slicer
gh_compas_slicer = reload(gh_compas_slicer)

if json_name and path and folder_name:
    vectors = gh_compas_slicer.load_json_vectors(path, folder_name, json_name)
else:
    gh_compas_slicer.missing_input()
# ---------- end csloadjsonvectors ----------
demesh_2 = DeconstructMesh(Mesh=mesh)  # -> Vertices, Faces, Colours, Normals
vdis_2 = VectorDisplay(Anchor=demesh_2.Vertices, Vector=csloadjsonvectors.vectors)

# ----
# Load Points
button_2 = Button()
csloadjsonpoints = CsLoadJsonPoints(recompute=button_2, json_name="pts_boundary_HIGH_0.json", path=py, folder_name=data)  # -> out, points; inputs recompute: Boolean
# ---------- csloadjsonpoints: Python ----------
"""
Loads a json file that stores a dictionary of N points in the format: 
data['0']=[x0,y0,z0], ...,  data['N']=[xN,yN,zN]


"""

import compas_slicer_ghpython.visualization as gh_compas_slicer
gh_compas_slicer = reload(gh_compas_slicer)

if json_name and path and folder_name:
    points = gh_compas_slicer.load_json_points(path, folder_name, json_name)
else:
    gh_compas_slicer.missing_input()
# ---------- end csloadjsonpoints ----------
pt_3 = Point(csloadjsonpoints.points)

# ----
# Load Slicer
panel_7 = Panel("curved_slicer.json")
csloadslicer_2 = CsLoadSlicer(recompute=Button(), json_name=panel_7, path=py, folder_name=data)  # -> out, mesh, paths, are_closed, all_points; inputs recompute: Boolean
# ---------- csloadslicer_2: Python ----------
"""
Loads a Slicer class from its json file in the 'output' folder.

"""

import compas_slicer_ghpython.visualization as gh_compas_slicer
gh_compas_slicer = reload(gh_compas_slicer)


if path and folder_name and json_name:
    mesh, paths, are_closed, all_points = gh_compas_slicer.load_slicer(path, folder_name, json_name)
    
else:
    gh_compas_slicer.missing_input()
# ---------- end csloadslicer_2 ----------

# ----
# Load Printpoints
panel_8 = Panel("out_printpoints.json")
csloadprintpoints_2 = CsLoadPrintpoints(recompute=Button(), json_name=panel_8, path=py, folder_name=data)  # -> out, geometry, points, frames, layer_heights, up_vectors, mesh_normals, closest_support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; inputs recompute: Boolean
# ---------- csloadprintpoints_2: Python ----------
"""
Loads a dictionaly of Printpoints from a json file in the 'output' folder.

"""

import compas_slicer_ghpython.visualization as gh_compas_slicer
gh_compas_slicer = reload(gh_compas_slicer)


if path and folder_name and json_name:
    points, frames, layer_heights, up_vectors, mesh_normals, closest_support, velocities, wait_times, \
    blend_radiuses, extruder_toggles = \
        gh_compas_slicer.load_printpoints(path, folder_name, json_name)
    
else:
    gh_compas_slicer.missing_input()
# ---------- end csloadprintpoints_2 ----------

panel_9 = Panel(csloadslicer_2.out)
panel_10 = Panel(csloadprintpoints_2.out)

all_points = Point(csloadslicer_2.all_points)
mesh_6 = Mesh(csloadslicer_2.mesh)
paths = Curve(csloadslicer_2.paths)

frames_2 = Plane(csloadprintpoints_2.frames)
points_2 = Point(csloadprintpoints_2.points)
layer_heights_2 = Number(csloadprintpoints_2.layer_heights)
up_vectors_2 = Vector(csloadprintpoints_2.up_vectors)
mesh_normals_2 = Vector(csloadprintpoints_2.mesh_normals)
cpts_2 = Point(csloadprintpoints_2.closest_support)

frames_3 = Plane(frames_2)
flippln = FlipPlane(Plane=frames_3, FlipX=False, FlipY=False, FlipZ=True)  # -> Flipped, R

print_planes = Plane(flippln.Flipped)
tool_mesh = Mesh(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)

# ----
# Tool Visualization
# Note: This is only an example. The actual tool orientation depends on the definition of the frame of your tool
number_slider_2 = Slider(1104, range=0..2000)
tool_origin = Panel("""0
0
99.507""")
cstoolviz = CsToolViz(origin_coords=tool_origin, mesh=tool_mesh, planes=print_planes, index=number_slider_2)  # -> out, mesh, passed_path; inputs origin_coords: list, mesh: Mesh, planes: list, index: Int32
# ---------- cstoolviz: Python ----------
"""
Example visualization of tool motion during the print.

"""

import compas_slicer_ghpython.visualization as gh_compas_slicer
gh_compas_slicer = reload(gh_compas_slicer)

if origin_coords and mesh and planes and (index or index==0):
    mesh, passed_path = gh_compas_slicer.tool_visualization(origin_coords, mesh, planes, index)
else:
    gh_compas_slicer.missing_input()
# ---------- end cstoolviz ----------

mesh_normals_3 = Vector(mesh_normals_2)
points_3 = Point(points_2)
section = Curve(rectangle.Rectangle)

mesh_7 = Mesh(cstoolviz.mesh)
geo = Geometry(cstoolviz.passed_path)
preview_2 = CustomPreview(Geometry=mesh_7, Material=ColourSwatch(SwatchColor=RGB(171, 171, 171)))
preview_3 = CustomPreview(Geometry=geo, Material=ColourSwatch(SwatchColor=RGB(255, 156, 36)))

velocities_2 = Number(csloadprintpoints_2.velocities)
wait_times_2 = Number(csloadprintpoints_2.wait_times)
blend_radiuses_2 = Number(csloadprintpoints_2.blend_radiuses)
extruder_toggles_2 = Number(csloadprintpoints_2.extruder_toggles)

# ----
# Ligthweight Path Visualization
number_slider_3 = Slider(3.9, range=0..10)
extruder_toggles_3 = Number(extruder_toggles_2)
all_points_2 = Point(points_2)
cslightpathviz = CsLightPathViz(
    points=all_points_2,
    extruder_toggles=extruder_toggles_3,
    domain_start=Slider(0, range=0..100),
    domain_end=Slider(1263, range=0..2000),
    pipe_diameter=number_slider_3)  # -> out, print_path_pipes, travel_path_lines; inputs points: list of Point3d, extruder_toggles: list of Boolean, domain_start: Int32, domain_end: Int32
# ---------- cslightpathviz: Python ----------
"""
Creates a lightweight visualization of the print paths. Segments with extruder_toggle=True are visualized as pipes, 
segments with extruder_toggle=False are visualized as lines.
Loads files from the 'output' folder.

"""

import compas_slicer_ghpython.visualization as gh_compas_slicer
gh_compas_slicer = reload(gh_compas_slicer)

pipe_resolution = 14

if points:
    
    # assign default values to parameters where possible. 
    if not extruder_toggles:
        extruder_toggles = [False for i in range(len(points))]
    if not domain_start:
        domain_start = 0
    if not domain_end:
        domain_end = len(points)
    if not pipe_diameter:
        pipe_diameter = 2.0
        
    print_path_pipes, travel_path_lines = \
        gh_compas_slicer.lightweight_path_visualization(points, extruder_toggles, domain_start, domain_end, pipe_diameter, pipe_resolution)
    
else:
    gh_compas_slicer.missing_input()
# ---------- end cslightpathviz ----------

# ----
# Render Path Visualization
toggle_2 = BooleanToggle(False)
extruder_toggles_4 = Number(extruder_toggles_2)
layer_heights_3 = Number(layer_heights_2)
up_vectors_3 = Vector(up_vectors_2)

python_2 = CsRenderPathViz(
    points=points_3,
    mesh_normals=mesh_normals_3,
    layer_heights=layer_heights_3,
    up_vectors=up_vectors_3,
    extruder_toggles=extruder_toggles_4,
    cross_section=section,
    planar_printing=toggle_2,
    compute=Toggle(True))  # -> out, loft_surfaces, travel_path_lines; inputs points: list of Point3d, mesh_normals: list of Vector3d, layer_heights: list, up_vectors: list of Vector3d, extruder_toggles: list of Boolean, cross_section: Curve, planar_printing: Boolean, compute: Boolean
# ---------- python_2: Python ----------
"""
Creates a render visualization of the print paths with loft surfaces where extruder_toggle=True.
For large number of points, this can take a while to compute, so keep it turned off unless you need it.
Loads files from the 'output' folder.

"""

import compas_slicer_ghpython.visualization as gh_compas_slicer
gh_compas_slicer = reload(gh_compas_slicer)

pipe_resolution = 14

if points and mesh_normals and layer_heights and extruder_toggles and cross_section:
    if compute:
        loft_surfaces, travel_path_lines = \
            gh_compas_slicer.render_path_visualization(points, mesh_normals, layer_heights, up_vectors, extruder_toggles, cross_section, planar_printing)
    else:
        print('Compute is set to False')
else:
    gh_compas_slicer.missing_input()
# ---------- end python_2 ----------

# ---- group: Color output
geo_2 = Geometry(cslightpathviz.travel_path_lines)
geo_3 = Geometry(cslightpathviz.print_path_pipes)
preview_4 = CustomPreview(Geometry=geo_3, Material=ColourSwatch(SwatchColor=RGB(199, 199, 199)))
preview_5 = CustomPreview(Geometry=geo_2, Material=ColourSwatch(SwatchColor=RGB(255, 156, 36)))

geo_4 = Geometry(python_2.loft_surfaces)
geo_5 = Geometry(python_2.travel_path_lines)
preview_6 = CustomPreview(Geometry=geo_4, Material=ColourSwatch(SwatchColor=RGB(222, 222, 222)))
preview_7 = CustomPreview(Geometry=geo_5, Material=ColourSwatch(SwatchColor=RGB(255, 156, 36)))

# ----
ln = Line(StartPoint=points_2, EndPoint=cpts_2)
vdis_3 = VectorDisplay(Anchor=points_2, Vector=expr("x*5", up_vectors_2))

# ---- group: Select parameter
num = Number(wait_times_2)

# ---- group: Visualize parameter with text
tag_offset = Slider(1, range=0..100)
pdecon = Deconstruct(Point=points_2)  # -> XComponent, YComponent, ZComponent
addition = Addition(A=pdecon.ZComponent, B=tag_offset)
pt_4 = ConstructPoint(XCoordinate=pdecon.XComponent, YCoordinate=pdecon.YComponent, ZCoordinate=addition)
tag = TextTag(Location=pt_4, Text=num, Colour=ColourSwatch(SwatchColor=RGB(50, 130, 186)))

# ---- group: Visualize parameter with color
bnd_3 = Bounds(Numbers=num)
avr = Average(Input=num)
dedomain_2 = DeconstructDomain(Domain=bnd_3)  # -> Start, End
average = Panel(avr)
gradient_2 = Gradient(
    LowerLimit=dedomain_2.Start,
    UpperLimit=dedomain_2.End,
    Parameter=num,
    stops=[0: RGB(0, 128, 0), 0.5: RGB(255, 255, 0), 1: RGB(255, 0, 0)])
pt_5 = Point(points_2)
cloud_2 = CloudDisplay(Points=pt_5, Colours=gradient_2, Size=Slider(3.96, range=0..10), SpriteType=0)

# ---- group: Slicer data
len = Length(Curve=flatten(paths))
lng = ListLength(List=flatten(paths))
sum = GhPythonScript(x=len)  # -> out, a; inputs x: list
# ---------- sum: Python ----------
__author__ = "Ioanna"
__version__ = "2020.10.25"

import rhinoscriptsyntax as rs

a = 0
for v in x:
    a += v
# ---------- end sum ----------
total_number_of_paths = Panel(lng)
total_path_length = Panel(sum.a)

# ----
min = Panel(dedomain_2.Start)
max = Panel(dedomain_2.End)

# ----
# Find files by name
button_3 = Button()
csfindfilenames = CsFindFilenames(recompute=button_3, starts_with="curved_slicer_", ends_with=".json", path=py, folder_name=data)  # -> out, filenames, n; inputs recompute: Boolean
# ---------- csfindfilenames: Python ----------
"""
Finds all the filenames from the output directory that have the specified name. 

"""

import compas_slicer_ghpython.visualization as gh_compas_slicer
gh_compas_slicer = reload(gh_compas_slicer)
import os

if starts_with and ends_with and path and folder_name:
    filenames = gh_compas_slicer.get_files_with_name(starts_with, ends_with, os.path.join(path, folder_name, 'output'))
    n = len(filenames)
else:
    gh_compas_slicer.missing_input()
# ---------- end csfindfilenames ----------
filenames = Panel(csfindfilenames.filenames)
number_of_files = Panel(csfindfilenames.n)

# ----
# Load Polylines
button_4 = Button()

csloadjsonpolylines = CsLoadJsonPolylines(recompute=button_4, json_name="point_clusters_polylines_0.json", path=py, folder_name=data)  # -> out, polylines, points; inputs recompute: Boolean
# ---------- csloadjsonpolylines: Python ----------
"""
Loads a json file that stores a dictionary of N polylines in the format:
data['0']=points_dict_0, ..., data['N'] = points_dict_N, where points_dict is in the format:
points_dict['0']=[x0,y0,z0], ...,  points_dict['N']=[xN,yN,zN]


"""

import compas_slicer_ghpython.visualization as gh_compas_slicer
gh_compas_slicer = reload(gh_compas_slicer)

if json_name and path and folder_name:
    polylines, points = gh_compas_slicer.load_json_polylines(path, folder_name, json_name)
else:
    gh_compas_slicer.missing_input()
# ---------- end csloadjsonpolylines ----------

crv_3 = Curve(csloadjsonpolylines.polylines)

# ----
# Load BaseBoundaries
button_5 = Button()

csloadjsonboundary = CsLoadJsonBoundary(recompute=button_5, path=py, folder_name=data)  # -> out, points, vectors, n; inputs recompute: Boolean
# ---------- csloadjsonboundary: Python ----------
"""
Loads a json file that stores a dictionary of BaseBoundary classes in the format:
data['0']=base_boundary_1.to_data(), ..., data['N']=base_boundary_N.to_data()


"""

import compas_slicer_ghpython.visualization as gh_compas_slicer
gh_compas_slicer = reload(gh_compas_slicer)

if json_name and path and folder_name:
    points, vectors, n = gh_compas_slicer.load_base_boundaries(path, folder_name, json_name)
else:
    gh_compas_slicer.missing_input()
# ---------- end csloadjsonboundary ----------

no_of_boundaries = Panel(csloadjsonboundary.n)
vdis_4 = VectorDisplay(Anchor=csloadjsonboundary.points, Vector=expr("x*3", csloadjsonboundary.vectors))

# ----
# Load Data
# Gradient norm
panel_11 = Panel("gradient_norm.json")
mesh_8 = Mesh(mesh)
demesh_3 = DeconstructMesh(Mesh=mesh_8)  # -> Vertices, Faces, Colours, Normals

csloadjsondata_2 = CsLoadJsonData(recompute=Button(), json_name=panel_11, path=py, folder_name=data)  # -> out, data; inputs recompute: Boolean; same code as csloadjsondata

data_2 = Data(csloadjsondata_2.data)
bnd_4 = Bounds(Numbers=data_2)
gradient_3 = Gradient(
    LowerLimit=Slider(0.1, range=0..0.1),
    UpperLimit=Slider(1, range=0..1),
    Parameter=data_2,
    stops=[0: RGB(234, 38, 0), 0.25: RGB(234, 126, 0), 0.5: RGB(254, 244, 84), 0.75: RGB(173, 203, 249), 1: RGB(75, 107, 169)])
avr_2 = Average(Input=data_2)
dedomain_3 = DeconstructDomain(Domain=bnd_4)  # -> Start, End
max_2 = Panel(dedomain_3.End)
min_2 = Panel(dedomain_3.Start)
average_2 = Panel(avr_2)
conmesh_2 = ConstructMesh(Vertices=demesh_3.Vertices, Faces=demesh_3.Faces, Colours=gradient_3)

# ----
# Load Data
# Load vertex indices
panel_12 = Panel("minima.json")
number_slider_4 = Slider(5.7, range=0..20)
demesh_4 = DeconstructMesh(Mesh=mesh)  # -> Vertices, Faces, Colours, Normals
merge_3 = Merge(Data1=panel_12, Data2="maxima.json", Data3="saddles.json")

csloadjsondata_3 = CsLoadJsonData(recompute=Button(), json_name=merge_3, path=py, folder_name=data)  # -> out, simplify(data); inputs recompute: Boolean; same code as csloadjsondata

branch = TreeBranch(Tree=csloadjsondata_3.data, Path="0", MaintainPaths=True)
branch_2 = TreeBranch(Tree=csloadjsondata_3.data, Path="1", MaintainPaths=True)
branch_3 = TreeBranch(Tree=csloadjsondata_3.data, Path="2", MaintainPaths=True)
item_5 = ListItem(List=demesh_4.Vertices, Index=branch, Wrap=True)
item_6 = ListItem(List=demesh_4.Vertices, Index=branch_2, Wrap=True)
item_7 = ListItem(List=demesh_4.Vertices, Index=branch_3, Wrap=True)
cloud_3 = CloudDisplay(Points=item_5, Colours=ColourSwatch(SwatchColor=RGB(107, 235, 52)), Size=number_slider_4, SpriteType=1)
cloud_4 = CloudDisplay(Points=item_6, Colours=ColourSwatch(SwatchColor=RGB(235, 52, 52)), Size=number_slider_4, SpriteType=1)
cloud_5 = CloudDisplay(Points=item_7, Colours=ColourSwatch(SwatchColor=RGB(18, 18, 18)), Size=number_slider_4, SpriteType=1)

# ----
# Load multiple meshes by name
button_6 = Button()

csloadmeshesbyname = CsLoadMeshesByName(recompute=button_6, starts_with="split_mesh_", ends_with=".obj", path=py, folder_name=data)  # -> out, loaded_meshes, n; inputs recompute: Boolean
# ---------- csloadmeshesbyname: Python ----------
"""
Loads all the meshes from the output directory that have the specified filename, and displays them with color.

"""

import compas_slicer_ghpython.visualization as gh_compas_slicer
gh_compas_slicer = reload(gh_compas_slicer)

if starts_with and ends_with and path and folder_name:
    loaded_meshes = gh_compas_slicer.load_multiple_meshes(starts_with, ends_with, path, folder_name)
    number_of_meshes = len(loaded_meshes)
else:
    gh_compas_slicer.missing_input()
# ---------- end csloadmeshesbyname ----------

medges_2 = MeshEdges(Mesh=csloadmeshesbyname.loaded_meshes)  # -> NakedEdges, InteriorEdges, NonManifoldEdges
number_of_meshes = Panel(csloadmeshesbyname.n)
crv_4 = Curve(medges_2.NakedEdges)
