# Grasshopper definition slicing_with_attributes.gh (Grasshopper 1.0.7)

data_folder_name = Panel("data")

# ----
# Output
# Input
py = PythonScript()  # -> path
# ---------- py: Python ----------
import sys
import os

ghComp = ghenv.Component
ghDoc = ghComp.OnPingDocument()

# the full path of the gh file
path = ghDoc.FilePath
# the current directory 
path = os.path.abspath(os.path.join(path, ".."))

print path
# ---------- end py ----------

# ---- group: Folder name
data = Data(data_folder_name)

# ----
# Load Slicer
panel = Panel("slicer_data.json")
csloadslicer = CsLoadSlicer(recompute=Button(), json_name=panel, path=py, folder_name=data)  # -> out, mesh, paths, are_closed, all_points; inputs recompute: Boolean
# ---------- csloadslicer: Python ----------
"""
Loads a Slicer class from its json file in the 'output' folder.

"""

import compas_slicer_ghpython.visualization as gh_compas_slicer
gh_compas_slicer = reload(gh_compas_slicer)


if path and folder_name and json_name:
    mesh, paths, are_closed, all_points = gh_compas_slicer.load_slicer(path, folder_name, json_name)
    
else:
    gh_compas_slicer.missing_input()
# ---------- end csloadslicer ----------

# ----
# Load Printpoints
panel_2 = Panel("out_printpoints.json")
csloadprintpoints = CsLoadPrintpoints(recompute=Button(), json_name=panel_2, path=py, folder_name=data)  # -> out, geometry, points, frames, layer_heights, up_vectors, mesh_normals, closest_support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; inputs recompute: Boolean
# ---------- csloadprintpoints: Python ----------
"""
Loads a dictionaly of Printpoints from a json file in the 'output' folder.

"""

import compas_slicer_ghpython.visualization as gh_compas_slicer
gh_compas_slicer = reload(gh_compas_slicer)


if path and folder_name and json_name:
    points, frames, layer_heights, up_vectors, mesh_normals, closest_support, velocities, wait_times, \
    blend_radiuses, extruder_toggles = \
        gh_compas_slicer.load_printpoints(path, folder_name, json_name)
    
else:
    gh_compas_slicer.missing_input()
# ---------- end csloadprintpoints ----------

panel_3 = Panel(csloadprintpoints.out)

frames = Plane(csloadprintpoints.frames)
points = Point(csloadprintpoints.points)
layer_heights = Number(csloadprintpoints.layer_heights)
up_vectors = Vector(csloadprintpoints.up_vectors)
mesh_normals = Vector(csloadprintpoints.mesh_normals)
cpts = Point(csloadprintpoints.closest_support)

velocities = Number(csloadprintpoints.velocities)
wait_times = Number(csloadprintpoints.wait_times)
blend_radiuses = Number(csloadprintpoints.blend_radiuses)
extruder_toggles = Number(csloadprintpoints.extruder_toggles)

mesh = Mesh(csloadslicer.mesh)
paths = Curve(csloadslicer.paths)
all_points = Point(csloadslicer.all_points)

pline = PolyLine(Vertices=points, Closed=False)
vdis = VectorDisplay(Anchor=points, Vector=expr("x*5", up_vectors))

# ---- group: Select parameter to display
list = ValueList({"Velocity": 0, "Wait time": 1, "Blend radius": 2, "Extruder Toggle": 3}, selected="Blend radius")

# ----
filter = StreamFilter(Gate=list, Stream0=velocities, Stream1=wait_times, Stream2=blend_radiuses, Stream3=extruder_toggles)
num = Number(filter)

# ---- group: Visualize parameter with text
tag_offset = Slider(1, range=0..100)
pdecon = Deconstruct(Point=points)  # -> XComponent, YComponent, ZComponent
addition = Addition(A=pdecon.ZComponent, B=tag_offset)
pt = ConstructPoint(XCoordinate=pdecon.XComponent, YCoordinate=pdecon.YComponent, ZCoordinate=addition)
tag = TextTag(Location=pt, Text=num, Colour=ColourSwatch(SwatchColor=RGB(50, 130, 186)))

# ---- group: Visualize parameter with color
bnd = Bounds(Numbers=num)
avr = Average(Input=num)
dedomain = DeconstructDomain(Domain=bnd)  # -> Start, End
average = Panel(avr)
gradient = Gradient(
    LowerLimit=dedomain.Start,
    UpperLimit=dedomain.End,
    Parameter=num,
    stops=[0: RGB(0, 128, 0), 0.5: RGB(255, 255, 0), 1: RGB(255, 0, 0)])
pt_2 = Point(points)
cloud = CloudDisplay(Points=pt_2, Colours=gradient, Size=Slider(3.96, range=0..10), SpriteType=0)

# ---- group: Slicer data
len = Length(Curve=flatten(paths))
lng = ListLength(List=flatten(paths))
ma = MassAddition(Input=len)  # -> Result, PartialResults
total_path_length = Panel(ma.Result)
total_number_of_paths = Panel(lng)

# ----
min = Panel(dedomain.Start)
max = Panel(dedomain.End)

# ---- group: PrintPoints
# Visualize Printpoints Attributes
points_2 = Point(points)

# ---- group: load data
panel_4 = Panel("dist_from_plane_list.json")
panel_5 = Panel("overhangs_list.json")
csloadjsondata = CsLoadJsonData(recompute=Button(), json_name="positive_y_axis_list.json", path=py, folder_name=data)  # -> out, data; inputs recompute: Boolean
# ---------- csloadjsondata: Python ----------
"""Loads a json file from the output folder. """

import compas_slicer_ghpython.visualization as gh_compas_slicer
gh_compas_slicer = reload(gh_compas_slicer)

if json_name and path and folder_name:
    data = gh_compas_slicer.load_json_file(path, folder_name, json_name)
else:
    gh_compas_slicer.missing_input()
# ---------- end csloadjsondata ----------
bnd_2 = Bounds(Numbers=csloadjsondata.data)
dedomain_2 = DeconstructDomain(Domain=bnd_2)  # -> Start, End
gradient_2 = Gradient(
    LowerLimit=dedomain_2.Start,
    UpperLimit=dedomain_2.End,
    Parameter=csloadjsondata.data,
    stops=[0: RGB(234, 38, 0), 0.25: RGB(234, 126, 0), 0.5: RGB(254, 244, 84), 0.75: RGB(173, 203, 249), 1: RGB(75, 107, 169)])

# ---- group: Load vectors
csloadjsonvectors = CsLoadJsonVectors(recompute=Button(), json_name="direction_to_pt_list.json", path=py, folder_name=data)  # -> out, vectors; inputs recompute: Boolean
# ---------- csloadjsonvectors: Python ----------
"""
Loads a json file from the 'output' folder, 
that stores a vector field in the format: 
data['0']=[x0,y0,z0], ...,  data['N']=[xN,yN,zN]


"""

import compas_slicer_ghpython.visualization as gh_compas_slicer
gh_compas_slicer = reload(gh_compas_slicer)

if json_name and path and folder_name:
    vectors = gh_compas_slicer.load_json_vectors(path, folder_name, json_name)
else:
    gh_compas_slicer.missing_input()
# ---------- end csloadjsonvectors ----------
vdis_2 = VectorDisplay(Anchor=points_2, Vector=csloadjsonvectors.vectors)

# ----
cloud_2 = CloudDisplay(Points=points_2, Colours=gradient_2, Size=Slider(3.31, range=0..10), SpriteType=0)
